# Grasshopper definition RhinoToUnityOrientationExample.gh (Grasshopper 1.0.7)

pt = Point(Point(275.0605952, 120.6350539, 0))
circle = CircleCNR(Center=pt, Normal=Vector(0, 0, 1), Radius="10")
divide = DivideCurve(Curve=circle, Count=10, Kinks=False)  # -> Points, Tangents, Parameters
eval = EvaluateCurve(Curve=circle, Parameter=divide.Parameters)  # -> Point, Tangent, Angle
vec2pt = Vector2Pt(PointA=eval.Point, PointB=pt, Unitize=False)  # -> Vector, Length
vdis = VectorDisplay(Anchor=eval.Point, Vector=eval.Tangent)
vdis_2 = VectorDisplay(Anchor=eval.Point, Vector=vec2pt.Vector)
lng = ListLength(List=eval.Point)
dup = DuplicateData(Data="INSTANTIATE::EXAMPLE::LAMP", Number=lng, Order=True)
c_script = CSharpScript(obj=dup, pts=eval.Point, fwd=eval.Tangent, up=vec2pt.Vector)  # -> out, P; inputs obj: list of String, pts: list of Point3d, fwd: list of Vector3d, up: list of Vector3d
# ---------- c_script: C# usings ----------
using System.IO;
using System.Linq;
# ---------- c_script: C# ----------
    string ghpath = this.Component.OnPingDocument().FilePath;
    string folder = new FileInfo(ghpath).Directory.FullName;
    string name = Path.GetFileNameWithoutExtension(Rhino.RhinoDoc.ActiveDoc.Name);
    string filepath = folder + "\\" + name + ".csv";

    //delete file if existing
    if(File.Exists(filepath))
    {
      try{File.Delete(filepath);}
      catch{Print("Close File Before Proceeding"); return;}
    }


    //create data to export to file
    List<string> data = new List<string>();
    string headers = "Layer,PositionX,PositionY,PositionZ,ForwardX,ForwardY,ForwardZ,NormalX,NormalY,NormalZ";
    data.Add(headers);
    for(int i = 0;i < obj.Count;i++)
    {
      //get info
      string layer = obj[i];
      Point3d position = pts[i];
      Vector3d forward = fwd[i];
      Vector3d normal = up[i];

      //add info as a row
      string[] info = new string[]{
        layer,
        (-position.X).ToString(),position.Z.ToString(),(-position.Y).ToString(),
        (-forward.X).ToString(),forward.Z.ToString(),(-forward.Y).ToString(),
        (-normal.X).ToString(),normal.Z.ToString(),(-normal.Y).ToString()
        };
      string row = string.Join(",", info);
      data.Add(row);
    }

    //add all data to the file
    System.IO.File.WriteAllLines(filepath, data.ToArray());
    P = filepath;
# ---------- end c_script ----------
panel = Panel(c_script.P)
panel_2 = Panel(c_script.out)
